# Grasshopper definition beam_joints.gh (Grasshopper 1.0.7)

# ----
# Reload Python Modules (if Module Code is Changed)
python_module_to_reload = Panel("""compas
compas_fab
roslibpy
integral_timber_joints""")
# Development Tools
reload = Button()
py = PythonScript(reload_module_button=reload, module_names=python_module_to_reload)  # inputs module_names: list
# ---------- py: Python ----------
import compas_ghpython
from compas_ghpython import unload_modules
if reload_module_button:
    for module in module_names:
        unload_modules(module)
# ---------- end py ----------

xy = XYPlane(Origin=Point(0, 0, 0))
xy_2 = XYPlane(Origin=Point(0, 200, 0))

# ----
# Check Path and Environment
compas_version = GhPythonScript()  # -> out, compas_version, compas_fab_version, compas_path, compas_fab_path, compas_env_name, python_directory
# ---------- compas_version: Python ----------
__author__ = "leungp"
__version__ = "2020.04.20"

import rhinoscriptsyntax as rs
import compas
import compas_fab
compas_version  = compas.__version__
compas_fab_version = compas_fab.__version__
import os
compas_path = os.path.abspath(compas.__file__)
compas_fab_path = os.path.abspath(compas_fab.__file__)

import compas_bootstrapper
compas_env_name = compas_bootstrapper.ENVIRONMENT_NAME
python_directory = compas_bootstrapper.PYTHON_DIRECTORY
# ---------- end compas_version ----------
compas_environment_name = Panel(compas_version.compas_env_name)
compas_version_2 = Panel(compas_version.compas_version)
compas_fab_version = Panel(compas_version.compas_fab_version)
compas_path = Panel(compas_version.compas_path)
compas_fab_path = Panel(compas_version.compas_fab_path)
python_directory = Panel(compas_version.python_directory)

pt = ConstructPoint(XCoordinate=Slider(1000, range=0..1000), YCoordinate=Slider(300, range=0..1000), ZCoordinate=0)
pt_2 = ConstructPoint(XCoordinate=Slider(100, range=0..1000), YCoordinate=Slider(629, range=0..1000), ZCoordinate=0)
beam = GhPythonScript(
    plane=xy,
    length=Slider(1000, range=0..1000),
    width=Slider(100, range=0..100),
    height=Slider(100, range=0..1000),
    name="b1")  # -> out, beam, assembly; inputs plane: Plane
# ---------- beam: Python ----------
from compas_rhino.geometry import RhinoMesh, RhinoPlane

from integral_timber_joints.geometry import Beam
from integral_timber_joints.assembly import Assembly

frame = RhinoPlane.from_geometry(plane).to_compas()

beam = Beam(frame, length, width, height, name)

assembly = Assembly()
assembly.add_beam(beam)
assembly.update_beam_mesh_with_joints(name, True)
# ---------- end beam ----------
beam_2 = GhPythonScript(
    plane=xy_2,
    length=Slider(1000, range=0..1000),
    width=Slider(100, range=0..100),
    height=Slider(100, range=0..1000),
    name="b1")  # -> out, beam, assembly; inputs plane: Plane; same code as beam
xy_3 = XYPlane(Origin=pt)
prot = RotatePlane(Plane=xy_3, Angle=degrees(Slider(140, range=-80..180)))
beam_3 = GhPythonScript(
    plane=prot,
    length=Slider(2000, range=0..2000),
    width=Slider(100, range=0..100),
    height=Slider(100, range=0..1000),
    name="b2")  # -> out, beam, assembly; inputs plane: Plane; same code as beam
xy_4 = XYPlane(Origin=pt_2)
prot_2 = RotatePlane(Plane=xy_4, Angle=degrees(Slider(0, range=0..100)))
beam_4 = GhPythonScript(
    plane=prot_2,
    length=Slider(3000, range=0..3000),
    width=Slider(100, range=0..100),
    height=Slider(100, range=0..1000),
    name="b1")  # -> out, beam, assembly; inputs plane: Plane; same code as beam
joint_90lap = GhPythonScript(
    assembly=beam.assembly,
    face_id=Slider(1, range=1..4),
    distance=Slider(309, range=0..1000),
    width=Slider(85, range=0..100),
    length=Slider(84, range=0..100),
    height=Slider(36, range=0..100))  # -> out, assembly_out
# ---------- joint_90lap: Python ----------
from integral_timber_joints.geometry import Beam, Joint_90lap
from copy import deepcopy

empty_beam = Beam(None,1,2,3,'b2')
assembly_out = deepcopy(assembly)

assembly_out.add_beam(empty_beam)

joint = Joint_90lap(distance, face_id, length, width, height)
assembly_out.add_one_joint(joint, assembly_out.sequence[0], assembly_out.sequence[1])
assembly_out.update_beam_mesh_with_joints(assembly_out.sequence[0])
# ---------- end joint_90lap ----------
joint_halflap = GhPythonScript(
    assembly=beam_2.assembly,
    face_id=Slider(4, range=1..4),
    angle=Slider(150, range=10..170),
    distance=Slider(245, range=0..1000),
    width=Slider(100, range=0..100),
    length=Slider(43, range=0..100),
    height=Slider(40, range=0..100))  # -> out, assembly_out, joint_mesh
# ---------- joint_halflap: Python ----------
from integral_timber_joints.geometry import Beam, Joint_halflap
from copy import deepcopy

from compas_ghpython.helpers import mesh_draw

empty_beam = Beam(None,1,2,3,'b2')
assembly_out = deepcopy(assembly)

assembly_out.add_beam(empty_beam)

joint = Joint_halflap(face_id, distance, angle, length, width, height)
assembly_out.add_one_joint(joint, assembly_out.sequence[0], assembly_out.sequence[1])
assembly_out.update_beam_mesh_with_joints(assembly_out.sequence[0])

joint_mesh = mesh_draw(joint.get_feature_mesh(assembly_out.beam(assembly_out.sequence[0])))
# ---------- end joint_halflap ----------
swap_faceid_to_opposite_face = GhPythonScript(assembly=joint_halflap.assembly_out)  # -> out, assembly_out
# ---------- swap_faceid_to_opposite_face: Python ----------
from copy import deepcopy

from compas_ghpython.helpers import mesh_draw

assembly_out = deepcopy(assembly)
beam_id = assembly_out.sequence[0]
assembly_out.joint((assembly_out.sequence[0], assembly_out.sequence[1])).swap_faceid_to_opposite_face()
assembly_out.update_beam_mesh_with_joints(beam_id)
# ---------- end swap_faceid_to_opposite_face ----------
assembly = GhPythonScript(beam1=beam_4.beam, beam2=beam_3.beam)  # -> out, assembly, joint1_mesh, joint2_mesh
# ---------- assembly: Python ----------
from compas_ghpython import unload_modules
unload_modules('integral_timber_joints')
from integral_timber_joints.assembly import Assembly
from integral_timber_joints.geometry import Joint_halflap_from_beam_beam_intersection
assembly = Assembly()
assembly.add_beam(beam1)
assembly.add_beam(beam2)

joint1, joint2 = Joint_halflap_from_beam_beam_intersection(beam1, beam2)
assembly.add_joint_pair(joint1, joint2, beam1.name, beam2.name)

assembly.update_beam_mesh_with_joints(beam1.name, True)
assembly.update_beam_mesh_with_joints(beam2.name, True)

from compas_ghpython.helpers import mesh_draw
joint1_mesh = mesh_draw(joint1.get_feature_mesh(assembly.beam(beam1.name)))
joint2_mesh = mesh_draw(joint2.get_feature_mesh(assembly.beam(beam2.name)))

print joint1.distance
print joint2.distance
# ---------- end assembly ----------
basic_assembly_preview = GhPythonScript(assembly=joint_90lap.assembly_out, beam_ids="b1")  # -> out, beam_mesh_prev; inputs beam_ids: list
# ---------- basic_assembly_preview: Python ----------
from compas_ghpython.helpers import mesh_draw

beam_mesh_prev = []

for beam_id in beam_ids:
    beam = assembly.beam(beam_id)
    beam_mesh_prev.append(mesh_draw(beam.cached_mesh))
# ---------- end basic_assembly_preview ----------
basic_assembly_preview_2 = GhPythonScript(assembly=joint_halflap.assembly_out, beam_ids="b1")  # -> out, beam_mesh_prev; inputs beam_ids: list; same code as basic_assembly_preview
clamp_frame = GhPythonScript(assembly=joint_halflap.assembly_out, beam_id="b1")  # -> out, frames, b
# ---------- clamp_frame: Python ----------
frames = []

from compas_ghpython import draw_frame
for joint in assembly.get_joints_of_beam(beam_id):
    for frame in joint.get_clamp_frames(assembly.beam(beam_id)):
        frames.append(draw_frame(frame))
# ---------- end clamp_frame ----------
basic_assembly_preview_3 = GhPythonScript(assembly=swap_faceid_to_opposite_face.assembly_out, beam_ids="b1")  # -> out, beam_mesh_prev; inputs beam_ids: list; same code as basic_assembly_preview
basic_assembly_preview_4 = GhPythonScript(assembly=assembly.assembly, beam_ids="b1")  # -> out, beam_mesh_prev; inputs beam_ids: list; same code as basic_assembly_preview
basic_assembly_preview_5 = GhPythonScript(assembly=assembly.assembly, beam_ids="b2")  # -> out, beam_mesh_prev; inputs beam_ids: list; same code as basic_assembly_preview
custom_preview = CustomPreview(Geometry=assembly.joint2_mesh, Material=ColourSwatch(SwatchColor=RGBA(0, 255, 204, 148)))
item = ListItem(List=clamp_frame.frames, Index=0, Wrap=True)
Z = UnitZ(Factor=Slider(500, range=0..1000))
move = Move(Geometry=basic_assembly_preview_3.beam_mesh_prev, Motion=Z)  # -> Geometry, Transform
Z_2 = UnitZ(Factor=100)
custom_preview_2 = CustomPreview(Geometry=basic_assembly_preview_2.beam_mesh_prev, Material=ColourSwatch(SwatchColor=RGBA(102, 255, 0, 148)))
custom_preview_3 = CustomPreview(Geometry=basic_assembly_preview.beam_mesh_prev, Material=ColourSwatch(SwatchColor=RGBA(102, 255, 0, 148)))
custom_preview_4 = CustomPreview(Geometry=move.Geometry, Material=ColourSwatch(SwatchColor=RGBA(255, 149, 0, 148)))
move_2 = Move(Geometry=basic_assembly_preview_4.beam_mesh_prev, Motion=Z_2)  # -> Geometry, Transform
custom_preview_5 = CustomPreview(Geometry=move_2.Geometry, Material=ColourSwatch(SwatchColor=RGBA(0, 255, 204, 148)))
custom_preview_6 = CustomPreview(Geometry=basic_assembly_preview_5.beam_mesh_prev, Material=ColourSwatch(SwatchColor=RGBA(0, 255, 204, 148)))
